# Grasshopper definition Mallard2Test.ghx (Grasshopper 1.0.7)
# plug-ins: GrasshopperAsyncComponentDemo, jSwan

list_airtable_records = ListAirtableRecords(BaseID="appsj7ZSiHOfUvzXk", AppKey="keyjxzgBUonIj836P", TableName="Table 2", ViewName="Grid view")  # -> ErrorMessage, OutRecords
merge = Merge(
    Data1="Name",
    Data2="Notes",
    Data3="Attachments",
    Data4="Status",
    Data5="multi",
    Data6="check",
    Data7="Collaborators",
    Data8="Date",
    Data9="barcode",
    Data10="Rating",
    Data11="URL",
    Data12="Departments",
    Data13="Notes (from Departments)")
list_item = ListItem(List=list_airtable_records.OutRecords, Index=Slider(2, range=0..10), Wrap=True)
airtable_record_fields = AirtableRecordFields(Records=list_airtable_records.OutRecords, FieldName=graft(merge))
tree_branch = TreeBranch(Tree=simplify(airtable_record_fields), Path=Slider(4, range=0..10), MaintainPaths=True)
deserialize_json = DeserializeJson(JSON=airtable_record_fields, OutputsLocked=False)  # -> Array, Text
airtable_record_fields_2 = AirtableRecordFields(Records=deserialize_json.Array, FieldName=graft("Company"))  # disabled
update_airtable_record = UpdateAirtableRecord(
    Toggle=Toggle(False),
    BaseID="appsj7ZSiHOfUvzXk",
    AppKey="keyjxzgBUonIj836P",
    TableName="Table 2",
    Record=list_item,
    FieldNames="multi",
    Fields="Dead")  # -> ErrorMessage, OutRecords
panel = Panel(update_airtable_record.OutRecords)
panel_2 = Panel(update_airtable_record.ErrorMessage)
